# Grasshopper definition test.gh (Grasshopper 1.0.7)
# plug-ins: FloorPlanGenerator, MeshEdit Components

curve = Curve(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)
point = Point(Point(2.033615851, -3.201871598, 0))
houseinstance = HouseInstance(Boundary=curve, EntrancePoint=point)
roominstance = RoomInstance()
roominstance_2 = RoomInstance()
trigger = Trigger(Interval=20, TimerInterval=20, Target=magnetizingrooms_heapes)  # disabled
roominstance_3 = RoomInstance()
number_slider = Slider(0, range=0..10)
magnetizingrooms_heapes = MagnetizingRooms_HeapES(
    HouseInstance=houseinstance,
    Iterations=Slider(200, range=0..1000),
    MaxAdjDistance=Slider(3, range=0..10),
    DisplayNumber=Slider(3, range=0..10),
    GapOfResult=Slider(1, range=0..10))  # -> Corridors, RoomBreps, RoomNames, Adjacencies, MissingAdjacences
roominstance_4 = RoomInstance()
tree_branch = TreeBranch(Tree=magnetizingrooms_heapes.Corridors, Path=number_slider, MaintainPaths=True)
tree_branch_2 = TreeBranch(Tree=magnetizingrooms_heapes.RoomNames, Path=number_slider, MaintainPaths=True)
tree_branch_3 = TreeBranch(Tree=magnetizingrooms_heapes.RoomBreps, Path=number_slider, MaintainPaths=True)
tree_branch_4 = TreeBranch(Tree=magnetizingrooms_heapes.Adjacencies, Path=number_slider, MaintainPaths=True)
tree_branch_5 = TreeBranch(Tree=magnetizingrooms_heapes.MissingAdjacences, Path=number_slider, MaintainPaths=True)

# ---- group: Display cluster
cluster = Cluster(brep_2=tree_branch, brep=tree_branch_3, txt_2=tree_branch_2, txt=tree_branch_4, int=tree_branch_5)

# ----
brep = Brep(tree_branch)
brep_2 = Brep(tree_branch_3)
brep_3 = Brep(tree_branch)
merge = Merge(Data1=brep_3, Data2=brep_2)
merge_2 = Merge(Data1="corridor", Data2=tree_branch_2)
list_item = ListItem(List=tree_branch_3, Index=Slider(0, range=0..10), Wrap=True)
edges = BrepEdges(Brep=merge)  # -> Naked, Interior, NonManifold
item = ListItem(List=brep_2, Index=0, Wrap=True)
custom_preview = CustomPreview(Geometry=brep, Material=ColourSwatch(SwatchColor=RGB(255, 255, 255)))
join = BrepJoin(Breps=flatten([brep_3, brep_2]))  # -> Breps, Closed
area = MeshArea(Mesh=merge)  # -> Area, Centroid
branch = TreeBranch(Tree=edges.Naked, Path="{0;0}", MaintainPaths=True)
edges_2 = BrepEdges(Brep=join.Breps)  # -> Naked, Interior, NonManifold
item_2 = ListItem(List=area.Centroid, Index=0, Wrap=True)
item_3 = ListItem(List=branch, Index=0, Wrap=True)
custom_preview_2 = CustomPreview(Geometry=list_item, Material=ColourSwatch(SwatchColor=RGB(0, 255, 30)))
crv = Curve(edges_2.Naked)
line = Line(edges_2.Naked)
genes = GenePool(Decimals=1, Maximum=1, Minimum=0, Value=[0.45, 0.37, 0.4, 0.58, 0.81])
Z = UnitZ(Factor=Slider(2.8, range=0..10))
number_slider_2 = Slider(3, range=0..10)
c_script = CSharpScript(boundary=line, roomsBoundary=edges.Naked, centerPoint=area.Centroid, roomName=merge_2, genePool=genes)  # -> out, A, B, FloorPolyLines, y1, Kc, Gc; inputs boundary: list of Line, roomsBoundary: tree of Line, centerPoint: list of Point3d, roomName: list of String, genePool: list of Double
# ---------- c_script: C# usings ----------
using System.Linq;
# ---------- c_script: C# ----------
    A = ClassifyLines(boundary, roomsBoundary);

    List<Wall> walls = new List<Wall>();
    walls = GetWalls(ClassifyLines(boundary, roomsBoundary), centerPoint, roomName);

    List<Line> north = new List<Line>();

    //List<Line> lines = walls.Branch(0).Where(x => x.Direction == Direction.North).Select(x => x.Line).ToList();

    List<Line> lines = walls.Where(x => x.Direction != Direction.Unset).Where(x => x.RoomName == "Room 0").Select(x => x.Line).ToList();

    B = lines;


    Floor floor = new Floor(walls, roomName);

    FloorPolyLines = floor.GetLinesInEachDirection();
# ---------- c_script: C# additional code ----------
  public DataTree<Line> ClassifyLines(List<Line> boundary, DataTree<Line> roomsBoundary)
  {
    DataTree<Line> classifyLines = new DataTree<Line>();


    for (int i = 0; i < roomsBoundary.BranchCount; i++)
    {
      List<Line> lines = new List<Line>();
      for (int j = 0; j < roomsBoundary.Branches[i].Count; j++)
      {
        for (int k = 0; k < boundary.Count; k++)
        {
          if (IsSameLine(boundary[k], roomsBoundary.Branches[i][j]))
          {
            lines.Add(boundary[k]);
          }
        }
      }
      classifyLines.AddRange(lines, new GH_Path(i));

    }
    return classifyLines;
  }

  public bool IsSameLine(Line a, Line b)
  {
    return (a.From == b.From && a.To == b.To) || (a.From == b.To && a.To == b.From);
  }


  public enum Direction{ Unset,South, West,North,East};

  public Direction GetDirection(Point3d centerPoint, Line line)
  {
    Point3d pointA = line.From;
    Point3d pointB = line.To;

    if(pointA.X == pointB.X && pointA.X < centerPoint.X)
      return Direction.West;
    else if (pointA.X == pointB.X && pointA.X >= centerPoint.X)
      return Direction.East;
    else if(pointA.Y == pointB.Y && pointA.Y >= centerPoint.Y)
      return Direction.North;
    else if(pointA.Y == pointB.Y && pointA.Y < centerPoint.Y)
      return Direction.South;
    else
      return Direction.Unset;
  }


  public List<Wall> GetWalls (DataTree<Line> lines, List<Point3d> centerPoint, List<string> names)
  {
    List<Wall> result = new List<Wall>();

    for (int i = 0; i < lines.BranchCount; i++)
    {
      List<Wall> walls = new List<Wall>();

      for (int j = 0; j < lines.Branches[i].Count; j++)
      {
        Wall wall = new Wall();
        wall.RoomName = names[i];
        wall.Line = lines.Branches[i][j];
        wall.Direction = GetDirection(centerPoint[i], wall.Line);

        walls.Add(wall);
      }

      result.AddRange(walls);
    }
    return result;
  }


  public class Wall
  {
    public Line Line = new Line();
    public Direction Direction ;
    public string RoomName = "";

  }



  public class Floor
  {
    public List<Wall> WestWall;
    public List<Wall> NorthWall;
    public List<Wall> EastWall;
    public List<Wall> SouthWall;

    public List<string> RoomName;

    public Floor(List<Wall> walls, List<string> roomName)
    {
      WestWall = walls.Where(x => x.Direction == Direction.West).Select(x => x).ToList();
      NorthWall = walls.Where(x => x.Direction == Direction.North).Select(x => x).ToList();
      EastWall = walls.Where(x => x.Direction == Direction.East).Select(x => x).ToList();
      SouthWall = walls.Where(x => x.Direction == Direction.South).Select(x => x).ToList();

      RoomName = roomName;
    }

    public DataTree<Polyline> GetLinesInEachDirection()
    {
      DataTree<Polyline> result = new DataTree<Polyline>();


      result.AddRange(GetLinesByNames(WestWall), new GH_Path(0));
      result.AddRange(GetLinesByNames(NorthWall), new GH_Path(1));
      result.AddRange(GetLinesByNames(EastWall), new GH_Path(2));
      result.AddRange(GetLinesByNames(SouthWall), new GH_Path(3));

      return result;
    }


    public List<Polyline> GetLinesByNames(List<Wall> walls)
    {
      List<Polyline> result = new List<Polyline>();

      foreach (string name in RoomName)
      {
        Polyline polyline = new Polyline(); // 合并后的多段线
        // 用于存储已添加的点的集合
        HashSet<Point3d> addedPoints = new HashSet<Point3d>();
        for (int i = 0; i < walls.Count; i++)
        {
          if (name == walls[i].RoomName)
          {
            var line = walls[i].Line;

            Point3d startPoint = line.From;
            Point3d endPoint = line.To;

            // 检查起点是否已添加
            if (!addedPoints.Contains(startPoint))
            {
              polyline.Add(startPoint);
              addedPoints.Add(startPoint);
            }

            // 检查终点是否已添加
            if (!addedPoints.Contains(endPoint))
            {
              polyline.Add(endPoint);
              addedPoints.Add(endPoint);
            }
          }

        }
        polyline = polyline.Count > 0 ? polyline : null;

        result.Add(polyline);
      }
      return result;
    }
  }
# ---------- end c_script ----------
extr = Extrude(Base=crv, Direction=Z)
branch_2 = TreeBranch(Tree=c_script.A, Path="{2;}", MaintainPaths=True)
crv_2 = Curve(c_script.FloorPolyLines)
panel = Panel("{1;}")
crv_3 = Curve(c_script.B)
crv_4 = Curve(branch_2)
Z_2 = UnitZ(Factor=Slider(1.2, range=0..10))
number_slider_3 = Slider(0.5, range=0..1)
multiplication = Multiplication(A="2.8", B=Slider(0.2, range=0..1))
move = Move(Geometry=crv_2, Motion=Z_2)  # -> Geometry, Transform
curvepoint = PointOnCurve(move.Geometry, parameter=0.5)
division = Division(A=Slider(0.5, range=0..1), B="2")
pdecon = Deconstruct(Point=curvepoint)  # -> XComponent, YComponent, ZComponent
subtraction = Subtraction(A=number_slider_3, B=division)
addition = Addition(A=number_slider_3, B=division)
addition_2 = Addition(A=pdecon.ZComponent, B=multiplication)
pt = ConstructPoint(XCoordinate=pdecon.XComponent, YCoordinate=pdecon.YComponent, ZCoordinate=addition_2)
eval = EvaluateCurve(Curve=reparameterize(move.Geometry), Parameter=addition)  # -> Point, Tangent, Angle
eval_2 = EvaluateCurve(Curve=reparameterize(move.Geometry), Parameter=subtraction)  # -> Point, Tangent, Angle
rec_3pt = Rectangle3Pt(PointA=eval.Point, PointB=eval_2.Point, PointC=pt)  # -> Rectangle, Length

# ==== cluster Cluster
txt = ClusterInput()
txt_2 = ClusterInput()
brep = ClusterInput()
brep_2 = ClusterInput()
int = ClusterInput()
txt_3 = Text(txt)
txt_4 = Text(txt_2)
brep_3 = Brep(brep)
brep_4 = Brep(brep_2)
int_2 = Integer(int)
txt_5 = Text(txt_4)
trim = TextTrim(Text=txt_3, Start=True, End=True)
len = TextLength(Text=txt_5)
min = Minimum(A="8", B=len)
fragment = TextFragment(Text=txt_5, Start="0", Count=min)
tmatch = MatchText(Text=fragment, Pattern="&&HALL&&", Case=True)
long = LongestList(ListA=tmatch, ListB="0", ListC="8", PaddingMode=2)  # -> ListA, ListB, ListC
brep_5 = Brep(brep_4)
brep_6 = Brep(brep_3)

# ---- group: Connections display
split = TextSplit(Text=trim, Separators="-,")
trim_2 = TextTrim(Text=split, Start=True, End=True)  # -> simplify(Result)
lng = ListLength(List=trim_2)  # -> expr("x-1", Length)
cull_i = CullIndex(List=trim_2, Indices=lng, Wrap=False)
int_3 = Integer(split)
dispatch = Dispatch(List=int_3, DispatchPattern=[True, False])  # -> ListA, ListB
item = ListItem(List=brep_6, Index=expr("x", dispatch.ListA), Wrap=True)
item_2 = ListItem(List=brep_6, Index=expr("x", dispatch.ListB), Wrap=True)
center = Center(Geometrical=item)  # -> Center, Dimension
center_2 = Center(Geometrical=item_2)  # -> Center, Dimension
ln = Line(StartPoint=center.Center, EndPoint=center_2.Center)
previewlw = CustomPreviewLineweights(Geometry=ln, Shader=ColourSwatch(SwatchColor=RGB(43, 43, 43)), Thickness=Slider(0.051, range=0..1), Absolute=True)

# ----
p_n_c = PickNChoose(Pattern=tmatch, Stream0=long.ListB, Stream1=long.ListC)
fragment_2 = TextFragment(Text=txt_5, Start=p_n_c)
txt_6 = Text(fragment_2)

# ---- group: Missing Adj Dots display
equals = Equality(FirstNumber=int_2, SecondNumber=0)  # -> Equality, Inequality
cull = CullPattern(List=brep_6, CullPattern=equals.Inequality)
center_3 = Center(Geometrical=cull)  # -> Center, Dimension
cir = Circle(Plane=center_3.Center, Radius=0.45)
boundary = BoundarySurfaces(Edges=cir)
previewlw_2 = CustomPreviewLineweights(Geometry=boundary, Shader=ColourSwatch(SwatchColor=RGB(227, 0, 0)), Absolute=False)

# ---- group: Names & Centers display
bbox = BoundingBox(Content=brep_6, Plane=PlaneXY(0, 0, 0))  # -> Box, Box_2
box_corners = BoxCorners(Box=bbox.Box)  # -> CornerA, CornerB, CornerC, CornerD, CornerE, CornerF, CornerG, CornerH
center_4 = Center(Geometrical=brep_6)  # -> Center, Dimension
text = DefineText(Text=txt_6, Plane=box_corners.CornerA, Size=".5", Font="IBM Plex Sans Condensed Medium", Justification=4)
previewlw_3 = CustomPreviewLineweights(Geometry=[center_4.Center, text], Shader=ColourSwatch(SwatchColor=RGB(0, 0, 0)), Absolute=False)

# ---- group: Corridors display
hsl = ColourHSL(Alpha=1, Hue=0, Saturation=0, Luminance=Slider(1, range=0..1))
previewmat = CustomPreviewMaterials(Geometry=brep_5, DiffuseColor=hsl)

# ---- group: House Edges DISPLAY
join = BrepJoin(Breps=flatten([brep_5, brep_6]))  # -> Breps, Closed
edges = BrepEdges(Brep=join.Breps)  # -> Naked, Interior, NonManifold
number_slider = Slider(0.104, range=0..4)
crv = Curve(edges.Naked)
join_2 = JoinCurves(Curves=crv, Preserve=False)
offset = Offset(Curve=flatten(join_2), Distance=expr("x/2", number_slider), Plane=PlaneXY(0, 0, 0), Corners=1)
previewlw_4 = CustomPreviewLineweights(Geometry=flatten(offset), Shader=ColourSwatch(SwatchColor=RGB(0, 0, 0)), Thickness=number_slider, Absolute=True)

# ---- group: Room colors display
lng_2 = ListLength(List=brep_6)
division = Division(A=".5", B=lng_2)
series = Series(Start=0, Step=division, Count=lng_2)
addition = Addition(A=series, B=Slider(0.108, range=0..1))
long_2 = LongestList(ListA=tmatch, ListB=Slider(0.637, range=0..1), ListC="1", PaddingMode=2)  # -> ListA, ListB, ListC

# ----
p_n_c_2 = PickNChoose(Pattern=tmatch, Stream0=long_2.ListB, Stream1=long_2.ListC)

# ---- group: Room colors display (continued)
hsl_2 = ColourHSL(Alpha=1, Hue=addition, Saturation=1, Luminance=p_n_c_2)
previewmat_2 = CustomPreviewMaterials(Geometry=brep_6, DiffuseColor=hsl_2)

# ---- group: Rooms Edges DISPLAY
crv_2 = Curve(simplify(brep_6))
subtraction = Subtraction(A=hsl_2, B=ColourSwatch(SwatchColor=RGB(71, 71, 71)))  # -> simplify(Result)
previewlw_5 = CustomPreviewLineweights(Geometry=crv_2, Shader=subtraction, Thickness=Slider(0.049, range=0..4), Absolute=True)
